# Grasshopper definition SUNPATH.gh (Grasshopper 1.0.8)

panel = Panel("https://climate.onebuilding.org/WMO_Region_2_Asia/BGD_Bangladesh/DH_Dhaka/BGD_DH_Tejgaon.AB.419230_TMYx.2011-2025.zip")
downloadepw = LBDownloadWeather(weather_URL=panel)  # -> epw_file, stat_file, ddy_file; plug-in component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
epwmap = LBEPWmap(epw_map=Toggle(True))  # -> report; plug-in component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
analysisperiod = LBAnalysisPeriod(
    start_month=Slider(1, range=1..12),
    start_day=Slider(1, range=1..31),
    start_hour=Slider(1, range=1..24),
    end_month=Slider(12, range=1..12),
    end_day=Slider(24, range=1..31),
    end_hour=Slider(18, range=1..24))  # -> period, hoys, dates; plug-in component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
importepw = LBImportEPW(epw_file=downloadepw.epw_file)  # -> location, dry_bulb_temperature, dew_point_temperature, relative_humidity, wind_speed, wind_direction, direct_normal_rad, diffuse_horizontal_rad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; plug-in component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
geo = Geometry([<mesh referenced from the Rhino model> x87, <brep referenced from the Rhino model>, <mesh referenced from the Rhino model> x1214])
pt = Point(<point referenced from the Rhino model>)
geo_2 = Geometry([<mesh referenced from the Rhino model> x1214])
sunpath = LBSunPath(location=importepw.location, hoys=analysisperiod.hoys, center_pt=pt, scale=Slider(7.61, range=0..10))  # -> report, vectors, altitudes, azimuths, hoys, sun_pts, analemma, daily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; plug-in component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
directsunhours = LBDirectSunHours(
    vectors=flatten(sunpath.vectors),
    geometry=flatten(geo_2),
    context=flatten(geo),
    grid_size=Slider(0.52, range=0..1),
    geo_block=Toggle(True),
    run=Toggle(True))  # -> report, points, results, mesh, legend, title, int_mtx; plug-in component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
