# Dynamo graph autometed.dyn (Dynamo 4.1.1.5050)
# packages: PythonNet3 Engine 1.4.8.0

string = StringInput("""import clr
import random
import math

clr.AddReference("RevitAPI")
from Autodesk.Revit.DB import *

clr.AddReference("RevitServices")
from RevitServices.Persistence import DocumentManager
from RevitServices.Transactions import TransactionManager

doc = DocumentManager.Instance.CurrentDBDocument


# ============================================================
# INPUTS
# ============================================================

cad_element = UnwrapElement(IN[0])
wall_type = UnwrapElement(IN[1])
base_level = UnwrapElement(IN[2])
min_level = UnwrapElement(IN[3])
max_level = UnwrapElement(IN[4])
roof_type = UnwrapElement(IN[5])


# ============================================================
# HEIGHT RANGE
# ============================================================

base_elev = base_level.Elevation
min_height = min_level.Elevation - base_elev
max_height = max_level.Elevation - base_elev


# ============================================================
# FIND CLOSED POLYLINES
# ============================================================

closed_polylines = []


def collect_geometry(geometry, transform):

    for geo in geometry:

        if isinstance(geo, PolyLine):

            pts = geo.GetCoordinates()

            if pts is None or len(pts) < 3:
                continue

            new_pts = []

            for p in pts:
                new_pts.append(transform.OfPoint(p))

            # Remove duplicate last point
            if new_pts[0].DistanceTo(new_pts[-1]) < 0.01:
                new_pts = new_pts[:-1]

            if len(new_pts) >= 3:
                closed_polylines.append(new_pts)

        elif isinstance(geo, GeometryInstance):

            new_transform = transform.Multiply(
                geo.Transform
            )

            collect_geometry(
                geo.GetInstanceGeometry(),
                new_transform
            )


options = Options()
options.ComputeReferences = False
options.IncludeNonVisibleObjects = True

geometry = cad_element.get_Geometry(options)

if geometry:
    collect_geometry(
        geometry,
        Transform.Identity
    )


# ============================================================
# OUTPUT LISTS
# ============================================================

all_walls = []
all_roofs = []
heights = []
roof_errors = []


# ============================================================
# TRANSACTION
# ============================================================

TransactionManager.Instance.EnsureInTransaction(doc)


# ============================================================
# PROCESS EVERY BLOCK
# ============================================================

for block_number, points in enumerate(closed_polylines):

    # --------------------------------------------------------
    # ONE RANDOM HEIGHT FOR THIS BLOCK
    # --------------------------------------------------------

    height = random.uniform(
        min_height,
        max_height
    )

    heights.append(height)

    block_walls = []


    # ========================================================
    # WALLS
    # ========================================================

    for i in range(len(points)):

        p1 = points[i]
        p2 = points[(i + 1) % len(points)]

        if p1.DistanceTo(p2) < 0.01:
            continue

        try:

            line = Line.CreateBound(p1, p2)

            wall = Wall.Create(
                doc,
                line,
                wall_type.Id,
                base_level.Id,
                height,
                0.0,
                False,
                False
            )

            block_walls.append(wall)

        except Exception:
            pass


    all_walls.append(block_walls)


    # ========================================================
    # ROOF
    # ========================================================

    try:

        footprint = CurveArray()

        for i in range(len(points)):

            p1 = points[i]
            p2 = points[(i + 1) % len(points)]

            if p1.DistanceTo(p2) < 0.01:
                continue

            footprint.Append(
                Line.CreateBound(p1, p2)
            )


        # ----------------------------------------------------
        # CREATE ROOF
        # ----------------------------------------------------

        model_curves = ModelCurveArray()

        result = doc.Create.NewFootPrintRoof(
            footprint,
            base_level,
            roof_type,
            model_curves
        )

        # PythonNet3 tuple
        roof = result[0]
        model_curves = result[1]


        # ----------------------------------------------------
        # MOVE ROOF TO WALL HEIGHT
        # ----------------------------------------------------

        offset = roof.get_Parameter(
            BuiltInParameter.ROOF_LEVEL_OFFSET_PARAM
        )

        if offset and not offset.IsReadOnly:
            offset.Set(height)


        # ----------------------------------------------------
        # PITCH
        # ----------------------------------------------------

        for mc in model_curves:

            try:

                roof.set_DefinesSlope(
                    mc,
                    True
                )

                roof.set_SlopeAngle(
                    mc,
                    math.radians(30)
                )

            except:
                pass


        all_roofs.append(roof)


    except Exception as e:

        # Don't stop other buildings
        all_roofs.append(None)

        roof_errors.append(
            "Block {} → {}".format(
                block_number + 1,
                str(e)
            )
        )


# ============================================================
# FINISH
# ============================================================

TransactionManager.Instance.TransactionTaskDone()


# ============================================================
# FLATTEN WALLS
# ============================================================

walls_flat = []

for block in all_walls:

    for wall in block:
        walls_flat.append(wall)


# ============================================================
# OUTPUT
# ============================================================

OUT = (
    walls_flat,
    all_roofs,
    heights,
    roof_errors
)""")
select_model_element = DSModelElementSelection()  # 1 picked in the model
wall_types = WallTypes("Generic - 6\"")
base_level = Levels("L1")
min_height = Levels("L2")
max_height = Levels("L3")
roof_types = RoofTypes("Generic - 9\"")
python_script_from_string = PythonStringNode(script=string, IN[0]=select_model_element, IN[1]=wall_types, IN[2]=base_level, IN[3]=min_height, IN[4]=max_height, IN[5]=roof_types)  # PythonNet3; graph output
