# Dynamo graph random height wall.dyn (Dynamo 4.1.1.5050)

cad_block = DSModelElementSelection()  # 1 picked in the model
geometry = Element.Geometry(element=cad_block)
curves = PolyCurve.Curves(polyCurve=geometry)
levels = Levels("L1")
levels_2 = Levels("L9")
wall_types = WallTypes("Generic - 200mm")
byCurveAndLevels = Wall.ByCurveAndLevels(curve=curves, startLevel=levels, endLevel=levels_2, wallType=wall_types)
