# Dynamo graph window.dyn (Dynamo 4.1.1.5050)

select_model_elements = DSModelElementsSelection()  # 20 picked in the model
family_types = FamilyTypes("M_Window-Fixed:750 x 1650mm")
family_types_2 = FamilyTypes("M_Window-Double-Hung:700 x 1200mm")
family_types_3 = FamilyTypes("M_Window-Casement-Double:1050 x 1350mm")
list_create = List.Create(item0=family_types, item1=family_types_2, item2=family_types_3)
wall_types = WallTypes("Generic - 200mm Filled")
number = DoubleInput(300)
number_2 = DoubleInput(600)
number_3 = DoubleInput(600)
number_4 = DoubleInput(1200)
number_5 = DoubleInput(3000)
number_6 = DoubleInput(9000)
number_7 = DoubleInput(600)
number_8 = DoubleInput(1200)
number_slider = DoubleSlider(0.25, range=0..1 step 0.05)
integer_slider = IntegerSlider(47, range=0..100 step 1)
levels = Levels("L1")
levels_2 = Levels("L2")
levels_3 = Levels("L3")
levels_4 = Levels("L4")
levels_5 = Levels("L5")
levels_6 = Levels("L6")
levels_7 = Levels("L7")
levels_8 = List.Create(item0=levels, item1=levels_2, item2=levels_3, item3=levels_4, item4=levels_5, item5=levels_6, item6=levels_7)
number_slider_2 = DoubleSlider(0.75, range=0..1 step 0.05)
python_script = Python(IN[0]=select_model_elements, IN[1]=list_create, IN[2]=wall_types, IN[3]=number, IN[4]=number_2, IN[5]=number_3, IN[6]=number_4, IN[7]=number_5, IN[8]=number_6, IN[9]=number_7, IN[10]=number_8, IN[11]=number_slider, IN[12]=integer_slider, IN[13]=levels_8, IN[14]=number_slider_2)  # PythonNet3
# ---------- python_script.python (591 lines) ----------
import clr
import random
import math

clr.AddReference("RevitServices")
from RevitServices.Persistence import DocumentManager
from RevitServices.Transactions import TransactionManager

clr.AddReference("RevitAPI")
from Autodesk.Revit.DB import *
from Autodesk.Revit.DB.Structure import StructuralType

doc = DocumentManager.Instance.CurrentDBDocument

# ============================================================
# INPUTS
# IN[0]  = Facade walls (may have different heights)
# IN[1]  = Window Family Types list
# IN[2]  = Shading fin Wall Type
# IN[3]  = Minimum gap (mm)
# IN[4]  = Edge clearance (mm)
# IN[5]  = Minimum sill height (mm)
# IN[6]  = Maximum sill height (mm)
# IN[7]  = Minimum fin height (mm)
# IN[8]  = Maximum fin height (mm)
# IN[9]  = Minimum fin projection (mm)
# IN[10] = Maximum fin projection (mm)
# IN[11] = Probability of fin, e.g. 0.10
# IN[12] = Random seed
# IN[13] = Level list L1-L7
# ============================================================

def as_list(value):
    if value is None:
        return []
    if isinstance(value, list):
        return [UnwrapElement(x) for x in value if x is not None]
    return [UnwrapElement(value)]

walls = as_list(IN[0])
window_types = as_list(IN[1])
fin_type = UnwrapElement(IN[2])
min_gap = float(IN[3]) / 304.8
edge_clearance = float(IN[4]) / 304.8
min_sill = float(IN[5]) / 304.8
max_sill = float(IN[6]) / 304.8
min_fin_height = float(IN[7]) / 304.8
max_fin_height = float(IN[8]) / 304.8
min_fin_depth = float(IN[9]) / 304.8
max_fin_depth = float(IN[10]) / 304.8
fin_probability = max(0.0, min(1.0, float(IN[11])))
seed = int(IN[12])
levels = sorted(as_list(IN[13]), key=lambda x: x.Elevation)

COVERAGE_TARGET = float(IN[14])
TOL = 1.0 / 304.8  # 1 mm in Revit internal feet
MAX_ATTEMPTS_PER_WALL = 500
rng = random.Random(seed)

# ============================================================
# VALIDATE INPUTS
# ============================================================

if not walls:
    raise Exception("IN[0]: Select facade walls.")

if not window_types:
    raise Exception("IN[1]: Select loaded window family types.")

if not isinstance(fin_type, WallType):
    raise Exception("IN[2]: Select a valid wall type for shading fins.")

if not levels:
    raise Exception("IN[13]: Connect the level list L1-L7.")

if min_gap < 0 or edge_clearance < 0:
    raise Exception("Gap and edge clearance must be non-negative.")

if min_sill < 0 or max_sill < min_sill:
    raise Exception("Check the sill height range.")

if min_fin_height <= 0 or max_fin_height < min_fin_height:
    raise Exception("Check the fin height range.")

if min_fin_depth <= 0 or max_fin_depth < min_fin_depth:
    raise Exception("Check the fin projection range.")

# ============================================================
# WINDOW TYPE DIMENSIONS
# ============================================================

def get_dimension(symbol, names):
    for name in names:
        try:
            p = symbol.LookupParameter(name)
            if p and p.StorageType == StorageType.Double:
                value = p.AsDouble()
                if value > 0:
                    return value
        except:
            pass
    return None

window_options = []

for symbol in window_types:
    if not isinstance(symbol, FamilySymbol):
        continue

    width = get_dimension(
        symbol, ["Width", "Rough Width", "width", "rough width"]
    )
    height = get_dimension(
        symbol, ["Height", "Rough Height", "height", "rough height"]
    )

    if width and height:
        window_options.append({
            "symbol": symbol,
            "width": width,
            "height": height
        })

if not window_options:
    raise Exception(
        "No usable window types found. Each type needs numeric Width "
        "and Height parameters. Add your family's actual parameter "
        "names to get_dimension() if necessary."
    )

# ============================================================
# GEOMETRY HELPERS
# ============================================================

def get_wall_axis(wall):
    curve = wall.Location.Curve
    p0 = curve.GetEndPoint(0)
    p1 = curve.GetEndPoint(1)
    return p0, (p1 - p0).Normalize(), curve.Length

def point_at(p0, direction, station, z):
    return XYZ(
        p0.X + direction.X * station,
        p0.Y + direction.Y * station,
        z
    )

def id_key(element):
    return str(element.Id)

def bbox_interval(element, p0, direction):
    bbox = element.get_BoundingBox(None)
    if bbox is None:
        return None

    projections = []
    for x in (bbox.Min.X, bbox.Max.X):
        for y in (bbox.Min.Y, bbox.Max.Y):
            for z in (bbox.Min.Z, bbox.Max.Z):
                pt = XYZ(x, y, z)
                delta = pt - p0
                projections.append(
                    delta.X * direction.X +
                    delta.Y * direction.Y
                )

    return {
        "left": min(projections),
        "right": max(projections),
        "bottom": bbox.Min.Z,
        "top": bbox.Max.Z
    }

def interval_conflict(a, b, gap):
    horizontal = (
        a["left"] < b["right"] + gap - TOL and
        a["right"] > b["left"] - gap + TOL
    )
    vertical = (
        a["bottom"] < b["top"] - TOL and
        a["top"] > b["bottom"] + TOL
    )
    return horizontal and vertical

def get_floor_zones(wall):
    bbox = wall.get_BoundingBox(None)
    if bbox is None:
        return []

    wall_bottom = bbox.Min.Z
    wall_top = bbox.Max.Z

    usable_levels = [
        lv for lv in levels
        if lv.Elevation >= wall_bottom - TOL
        and lv.Elevation < wall_top - TOL
    ]

    zones = []

    for i, level in enumerate(usable_levels):
        base = max(wall_bottom, level.Elevation)

        if i + 1 < len(usable_levels):
            top = min(wall_top, usable_levels[i + 1].Elevation)
        else:
            top = wall_top

        if top - base > TOL:
            zones.append({
                "level": level,
                "base": base,
                "top": top
            })

    return zones

# ============================================================
# LEVEL-BY-LEVEL PLANNING
# For each level, process all wall zones before advancing.
# Coverage is measured per wall per floor zone.
# Gaps do not count as occupied facade.
# ============================================================

plans = []
skipped = []
level_report = []

for level in levels:
    level_candidates = []

    for wall in walls:
        if not isinstance(wall, Wall):
            continue

        if not isinstance(wall.Location, LocationCurve):
            skipped.append("Invalid wall location: " + id_key(wall))
            continue

        if not isinstance(wall.Location.Curve, Line):
            skipped.append("Curved wall skipped: " + id_key(wall))
            continue

        bbox = wall.get_BoundingBox(None)
        if bbox is None:
            continue

        p0, direction, length = get_wall_axis(wall)
        if length <= 0:
            continue

        # Process this wall only if the current level defines one
        # of its floor zones.
        zones = get_floor_zones(wall)
        zone = None

        for z in zones:
            if id_key(z["level"]) == id_key(level):
                zone = z
                break

        if zone is None:
            continue

        normal = wall.Orientation
        normal = XYZ(normal.X, normal.Y, 0)

        if normal.GetLength() < 0.000001:
            skipped.append("Invalid wall normal: " + id_key(wall))
            continue

        normal = normal.Normalize()

        usable_length = length - 2.0 * edge_clearance
        if usable_length <= TOL:
            skipped.append("No usable length: " + id_key(wall))
            continue

        floor_height = zone["top"] - zone["base"]
        station = edge_clearance
        occupied = 0.0
        target = usable_length * COVERAGE_TARGET
        attempts = 0
        wall_plans = []

        while occupied < target and attempts < MAX_ATTEMPTS_PER_WALL:
            attempts += 1

            remaining = length - edge_clearance - station
            if remaining <= TOL:
                break

            # Randomly decide whether this candidate is a fin.
            choose_fin = rng.random() < fin_probability

            fitting_windows = [
                item for item in window_options
                if item["height"] + min_sill <= floor_height + TOL
            ]

            if not fitting_windows:
                choose_fin = True

            if choose_fin:
                # Fin thickness occupies facade width; projection is
                # perpendicular and does not count as facade coverage.
                fin_footprint = fin_type.Width

                if fin_footprint + min_gap > remaining:
                    break

                fin_height = min(
                    rng.uniform(min_fin_height, max_fin_height),
                    floor_height
                )

                if fin_height <= TOL:
                    break

                candidate = {
                    "kind": "fin",
                    "wall": wall,
                    "level": level,
                    "p0": p0,
                    "direction": direction,
                    "normal": normal,
                    "station": station + fin_footprint / 2.0,
                    "base": zone["base"],
                    "height": fin_height,
                    "depth": rng.uniform(min_fin_depth, max_fin_depth),
                    "footprint": fin_footprint
                }

            else:
                item = rng.choice(fitting_windows)
                width = item["width"]
                height = item["height"]

                if width + min_gap > remaining:
                    break

                sill_max = min(max_sill, floor_height - height)
                if sill_max < min_sill:
                    break

                sill = rng.uniform(min_sill, sill_max)

                candidate = {
                    "kind": "window",
                    "wall": wall,
                    "level": level,
                    "p0": p0,
                    "direction": direction,
                    "station": station + width / 2.0,
                    "base": zone["base"],
                    "point": point_at(
                        p0, direction, station + width / 2.0,
                        zone["base"] + sill
                    ),
                    "symbol": item["symbol"],
                    "width": width,
                    "height": height,
                    "sill": sill,
                    "footprint": width
                }

            # Candidate is appended; next candidate starts after its
            # facade footprint plus the required gap.
            wall_plans.append(candidate)
            occupied += candidate["footprint"]
            station += candidate["footprint"] + min_gap

        plans.extend(wall_plans)

        level_candidates.append({
            "wall_id": id_key(wall),
            "usable_length_ft": usable_length,
            "target_coverage": COVERAGE_TARGET,
            "planned_coverage": (
                occupied / usable_length if usable_length > 0 else 0
            ),
            "candidate_count": len(wall_plans)
        })

    level_report.append({
        "level": level.Name,
        "walls": level_candidates
    })

# ============================================================
# RESERVE FINS BEFORE WINDOW PLACEMENT
# Reject windows whose nominal footprint conflicts with a fin.
# ============================================================

planned_fins = [p for p in plans if p["kind"] == "fin"]
valid_plans = []

for plan in plans:
    if plan["kind"] == "fin":
        valid_plans.append(plan)
        continue

    win_left = plan["station"] - plan["width"] / 2.0
    win_right = plan["station"] + plan["width"] / 2.0
    win_bottom = plan["base"] + plan["sill"]
    win_top = win_bottom + plan["height"]

    blocked = False

    for fin in planned_fins:
        if id_key(fin["wall"]) != id_key(plan["wall"]):
            continue

        fin_left = fin["station"] - fin["footprint"] / 2.0
        fin_right = fin["station"] + fin["footprint"] / 2.0
        fin_bottom = fin["base"]
        fin_top = fin_bottom + fin["height"]

        horizontal = (
            win_left < fin_right + min_gap and
            win_right > fin_left - min_gap
        )
        vertical = (
            win_bottom < fin_top and
            win_top > fin_bottom
        )

        if horizontal and vertical:
            blocked = True
            break

    if not blocked:
        valid_plans.append(plan)

# ============================================================
# CREATE FIN WALLS FIRST, THEN WINDOWS
# ============================================================

created_windows = []
created_fins = []
window_records = []
fin_records = []
errors = []

TransactionManager.Instance.EnsureInTransaction(doc)

try:
    symbols = {}
    for plan in valid_plans:
        if plan["kind"] == "window":
            symbols[id_key(plan["symbol"])] = plan["symbol"]

    for symbol in symbols.values():
        if not symbol.IsActive:
            symbol.Activate()

    doc.Regenerate()

    # Create fins first.
    for plan in valid_plans:
        if plan["kind"] != "fin":
            continue

        try:
            level_z = plan["level"].Elevation
            offset = plan["base"] - level_z

            start = point_at(
                plan["p0"], plan["direction"], plan["station"],
                level_z
            )
            end = start + plan["normal"] * plan["depth"]

            fin = Wall.Create(
                doc,
                Line.CreateBound(start, end),
                fin_type.Id,
                plan["level"].Id,
                plan["height"],
                offset,
                False,
                False
            )

            doc.Regenerate()

            actual = bbox_interval(
                fin, plan["p0"], plan["direction"]
            )

            created_fins.append(fin)

            if actual:
                fin_records.append({
                    "wall_id": id_key(plan["wall"]),
                    "interval": actual
                })

        except Exception as ex:
            errors.append("Fin placement failed: " + str(ex))

    # Create windows and reject actual bounding-box conflicts.
    for plan in valid_plans:
        if plan["kind"] != "window":
            continue

        instance = None

        try:
            instance = doc.Create.NewFamilyInstance(
                plan["point"],
                plan["symbol"],
                plan["wall"],
                StructuralType.NonStructural
            )

            doc.Regenerate()

            actual = bbox_interval(
                instance, plan["p0"], plan["direction"]
            )

            conflict = actual is None

            if actual:
                # Ensure actual geometry stays inside the wall edges.
                wall_length = plan["wall"].Location.Curve.Length

                if (
                    actual["left"] < edge_clearance - TOL or
                    actual["right"] > wall_length - edge_clearance + TOL
                ):
                    conflict = True

                # Window-to-window spacing.
                for rec in window_records:
                    if rec["wall_id"] != id_key(plan["wall"]):
                        continue
                    if interval_conflict(
                        actual, rec["interval"], min_gap
                    ):
                        conflict = True
                        break

                # Window-to-fin exclusion.
                for rec in fin_records:
                    if rec["wall_id"] != id_key(plan["wall"]):
                        continue
                    if interval_conflict(
                        actual, rec["interval"], min_gap
                    ):
                        conflict = True
                        break

            if conflict:
                doc.Delete(instance.Id)
                errors.append(
                    "Rejected window due to actual overlap or edge clearance: "
                    + id_key(plan["wall"])
                )
            else:
                created_windows.append(instance)
                window_records.append({
                    "wall_id": id_key(plan["wall"]),
                    "interval": actual
                })

        except Exception as ex:
            if instance is not None:
                try:
                    doc.Delete(instance.Id)
                except:
                    pass
            errors.append("Window placement failed: " + str(ex))

finally:
    TransactionManager.Instance.TransactionTaskDone()

# ============================================================
# OUTPUT
# ============================================================

OUT = {
    "WindowsCreated": created_windows,
    "ShadingFinsCreated": created_fins,
    "LevelCoveragePlan": level_report,
    "PlannedCandidates": len(plans),
    "CandidatesAfterFinChecks": len(valid_plans),
    "Errors": errors,
    "SkippedWalls": skipped
}
# ----------------------------------------
